# Grasshopper definition meisaku-grasshopper-08-sample.gh (Grasshopper 1.0.7)

neg = Negative(Value=Slider(100, range=0..100))
neg_2 = Negative(Value=Slider(20, range=0..100))
neg_3 = Negative(Value=Slider(26, range=0..100))
neg_4 = Negative(Value=Slider(23, range=0..100))
neg_5 = Negative(Value=Slider(56, range=0..100))
neg_6 = Negative(Value=Slider(97, range=0..100))
neg_7 = Negative(Value=Slider(13, range=0..100))
neg_8 = Negative(Value=Slider(16, range=0..100))
neg_9 = Negative(Value=Slider(100, range=0..100))
neg_10 = Negative(Value=Slider(20, range=0..100))
neg_11 = Negative(Value=Slider(26, range=0..100))
neg_12 = Negative(Value=Slider(23, range=0..100))
neg_13 = Negative(Value=Slider(38, range=0..100))
neg_14 = Negative(Value=Slider(97, range=0..100))
neg_15 = Negative(Value=Slider(13, range=0..100))
neg_16 = Negative(Value=Slider(25, range=0..100))
pt = ConstructPoint(XCoordinate=0, YCoordinate=neg, ZCoordinate=Slider(30, range=0..100))
pt_2 = ConstructPoint(XCoordinate=0, YCoordinate=neg, ZCoordinate=0)
pt_3 = ConstructPoint(XCoordinate=0, YCoordinate=0, ZCoordinate=0)
pt_4 = ConstructPoint(XCoordinate=0, YCoordinate=0, ZCoordinate=Slider(100, range=0..100))
pt_5 = ConstructPoint(XCoordinate=0, YCoordinate=neg_9, ZCoordinate=Slider(30, range=0..100))
pt_6 = ConstructPoint(XCoordinate=0, YCoordinate=neg_9, ZCoordinate=0)
pt_7 = ConstructPoint(XCoordinate=0, YCoordinate=0, ZCoordinate=0)
pt_8 = ConstructPoint(XCoordinate=0, YCoordinate=0, ZCoordinate=Slider(100, range=0..100))
vec = VectorXYZ(XComponent=0, YComponent=Slider(13, range=0..20), ZComponent=Slider(7, range=0..10))  # -> Vector, Length
vec_2 = VectorXYZ(XComponent=0, YComponent=neg_2, ZComponent=Slider(14, range=0..100))  # -> Vector, Length
vec_3 = VectorXYZ(XComponent=0, YComponent=neg_3, ZComponent=neg_4)  # -> Vector, Length
vec_4 = VectorXYZ(XComponent=0, YComponent=Slider(19, range=0..100), ZComponent=neg_5)  # -> Vector, Length
vec_5 = VectorXYZ(XComponent=0, YComponent=neg_6, ZComponent=Slider(25, range=0..100))  # -> Vector, Length
vec_6 = VectorXYZ(XComponent=0, YComponent=neg_7, ZComponent=Slider(0, range=0..100))  # -> Vector, Length
vec_7 = VectorXYZ(XComponent=0, YComponent=Slider(2, range=0..100), ZComponent=Slider(11, range=0..100))  # -> Vector, Length
vec_8 = VectorXYZ(XComponent=0, YComponent=Slider(75, range=0..100), ZComponent=neg_8)  # -> Vector, Length
vec_9 = VectorXYZ(XComponent=0, YComponent=Slider(12, range=0..100), ZComponent=Slider(42, range=0..100))  # -> Vector, Length
vec_10 = VectorXYZ(XComponent=0, YComponent=Slider(8, range=0..100), ZComponent=Slider(67, range=0..100))  # -> Vector, Length
vec_11 = VectorXYZ(XComponent=0, YComponent=Slider(6, range=0..100), ZComponent=Slider(11, range=0..100))  # -> Vector, Length
vec_12 = VectorXYZ(XComponent=0, YComponent=Slider(13, range=0..20), ZComponent=Slider(7, range=0..10))  # -> Vector, Length
vec_13 = VectorXYZ(XComponent=0, YComponent=neg_10, ZComponent=Slider(14, range=0..100))  # -> Vector, Length
vec_14 = VectorXYZ(XComponent=0, YComponent=neg_11, ZComponent=neg_12)  # -> Vector, Length
vec_15 = VectorXYZ(XComponent=0, YComponent=Slider(19, range=0..100), ZComponent=neg_13)  # -> Vector, Length
vec_16 = VectorXYZ(XComponent=0, YComponent=neg_14, ZComponent=Slider(25, range=0..100))  # -> Vector, Length
vec_17 = VectorXYZ(XComponent=0, YComponent=neg_15, ZComponent=Slider(0, range=0..100))  # -> Vector, Length
vec_18 = VectorXYZ(XComponent=0, YComponent=Slider(0, range=0..100), ZComponent=Slider(35, range=0..100))  # -> Vector, Length
vec_19 = VectorXYZ(XComponent=0, YComponent=Slider(80, range=0..100), ZComponent=neg_16)  # -> Vector, Length
vec_20 = VectorXYZ(XComponent=0, YComponent=Slider(8, range=0..100), ZComponent=Slider(39, range=0..100))  # -> Vector, Length
vec_21 = VectorXYZ(XComponent=0, YComponent=Slider(5, range=0..100), ZComponent=Slider(50, range=0..100))  # -> Vector, Length
vec_22 = VectorXYZ(XComponent=0, YComponent=Slider(6, range=0..100), ZComponent=Slider(11, range=0..100))  # -> Vector, Length
pt_9 = Point(pt)
move = Move(Geometry=pt_4, Motion=vec.Vector)  # -> Geometry, Transform
move_2 = Move(Geometry=move.Geometry, Motion=vec_2.Vector)  # -> Geometry, Transform
move_3 = Move(Geometry=move_2.Geometry, Motion=vec_3.Vector)  # -> Geometry, Transform
move_4 = Move(Geometry=move_3.Geometry, Motion=vec_4.Vector)  # -> Geometry, Transform
move_5 = Move(Geometry=move_4.Geometry, Motion=vec_5.Vector)  # -> Geometry, Transform
move_6 = Move(Geometry=pt_9, Motion=vec_6.Vector)  # -> Geometry, Transform
move_7 = Move(Geometry=pt_9, Motion=vec_7.Vector)  # -> Geometry, Transform
move_8 = Move(Geometry=move_7.Geometry, Motion=vec_8.Vector)  # -> Geometry, Transform
move_9 = Move(Geometry=move_8.Geometry, Motion=vec_9.Vector)  # -> Geometry, Transform
move_10 = Move(Geometry=move_8.Geometry, Motion=vec_10.Vector)  # -> Geometry, Transform
move_11 = Move(Geometry=move_10.Geometry, Motion=vec_11.Vector)  # -> Geometry, Transform
move_12 = Move(Geometry=pt_8, Motion=vec_12.Vector)  # -> Geometry, Transform
move_13 = Move(Geometry=move_12.Geometry, Motion=vec_13.Vector)  # -> Geometry, Transform
move_14 = Move(Geometry=move_13.Geometry, Motion=vec_14.Vector)  # -> Geometry, Transform
move_15 = Move(Geometry=move_14.Geometry, Motion=vec_15.Vector)  # -> Geometry, Transform
move_16 = Move(Geometry=move_15.Geometry, Motion=vec_16.Vector)  # -> Geometry, Transform
pt_10 = Point(pt_4)
pt_11 = Point(pt_5)
move_17 = Move(Geometry=pt_11, Motion=vec_17.Vector)  # -> Geometry, Transform
move_18 = Move(Geometry=pt_11, Motion=vec_18.Vector)  # -> Geometry, Transform
move_19 = Move(Geometry=move_18.Geometry, Motion=vec_19.Vector)  # -> Geometry, Transform
move_20 = Move(Geometry=move_19.Geometry, Motion=vec_20.Vector)  # -> Geometry, Transform
move_21 = Move(Geometry=move_19.Geometry, Motion=vec_21.Vector)  # -> Geometry, Transform
move_22 = Move(Geometry=move_21.Geometry, Motion=vec_22.Vector)  # -> Geometry, Transform
pt_12 = Point(pt_8)
pline = PolyLine(Vertices=[pt, pt_2, pt_3, pt_4], Closed=False)
nurbs = NurbsCurve(
    Vertices=[pt_4, move.Geometry, move_2.Geometry, move_3.Geometry, move_4.Geometry, move_5.Geometry, move_6.Geometry, pt_9],
    Degree=3,
    Periodic=False)  # -> Curve, Length, Domain
nurbs_2 = NurbsCurve(
    Vertices=[pt_9, move_7.Geometry, move_8.Geometry, move_9.Geometry, move_10.Geometry, move_11.Geometry, pt_10],
    Degree=3,
    Periodic=False)  # -> Curve, Length, Domain
pline_2 = PolyLine(Vertices=[pt_5, pt_6, pt_7, pt_8], Closed=False)
nurbs_3 = NurbsCurve(
    Vertices=[pt_8, move_12.Geometry, move_13.Geometry, move_14.Geometry, move_15.Geometry, move_16.Geometry, move_17.Geometry, pt_11],
    Degree=3,
    Periodic=False)  # -> Curve, Length, Domain
nurbs_4 = NurbsCurve(
    Vertices=[pt_11, move_18.Geometry, move_19.Geometry, move_20.Geometry, move_21.Geometry, move_22.Geometry, pt_12],
    Degree=3,
    Periodic=False)  # -> Curve, Length, Domain
join = JoinCurves(Curves=[nurbs.Curve, nurbs_2.Curve], Preserve=False)
join_2 = JoinCurves(Curves=[pline, nurbs_2.Curve], Preserve=False)
join_3 = JoinCurves(Curves=[nurbs_3.Curve, nurbs_4.Curve], Preserve=False)
join_4 = JoinCurves(Curves=[pline_2, nurbs_4.Curve], Preserve=False)
number_slider = Slider(10, range=0..100)
number_slider_2 = Slider(10, range=0..100)
neg_17 = Negative(Value=Slider(2, range=0..10))
neg_18 = Negative(Value=Slider(2, range=0..10))
Y = UnitY(Factor=number_slider)
Y_2 = UnitY(Factor=number_slider_2)
vec_23 = VectorXYZ(XComponent=0, YComponent=number_slider, ZComponent=neg_17)  # -> Vector, Length
vec_24 = VectorXYZ(XComponent=0, YComponent=number_slider_2, ZComponent=neg_18)  # -> Vector, Length
move_23 = Move(Geometry=join, Motion=vec_23.Vector)  # -> Geometry, Transform
move_24 = Move(Geometry=join_2, Motion=Y)  # -> Geometry, Transform
move_25 = Move(Geometry=join_3, Motion=vec_24.Vector)  # -> Geometry, Transform
move_26 = Move(Geometry=join_4, Motion=Y_2)  # -> Geometry, Transform
